# Grasshopper definition panel-casing.ghx (Grasshopper 1.0.7)
# plug-ins: LunchBox, Kangaroo2 Components

paraboloid = HyperbolicParaboloid(U=100, V=100, a=2, b=2, S=5, D1=Domain(-4, 4), D2=Domain(-4, 4))
mesh_uv = MeshSurface(Surface=paraboloid, UCount=5, VCount=5, Overhang=True, Equalize=False)
tri = Triangulate(Mesh=mesh_uv)  # -> Mesh, Count
demesh = DeconstructMesh(Mesh=tri.Mesh)  # -> Vertices, Faces, Colours, Normals
deface = DeconstructFace(Face=demesh.Faces)  # -> CornerA, CornerB, CornerC, CornerD
panel = Panel(demesh.Faces)
entwine = Entwine(Branch00=deface.CornerA, Branch01=deface.CornerB, Branch02=deface.CornerC, FlattenInputs=True)
item = ListItem(List=demesh.Vertices, Index=entwine, Wrap=True)
flip = FlipMatrix(Data=item)
bang = ExplodeTree(Data=item)  # -> Branch0, Branch1, Branch2
conmesh = ConstructMesh(Vertices=flip, Faces="T{0;1;2}")  # -> flatten(Mesh)
srf4pt = _4PointSurface(CornerA=bang.Branch0, CornerB=bang.Branch1, CornerC=bang.Branch2)
clean = CombineClean(Meshes=conmesh)
join = BrepJoin(Breps=srf4pt)  # -> Breps, Closed
version = Panel(tri.Mesh)
version_2 = Panel(clean)
panel_2 = Panel(srf4pt)
