# Grasshopper definition saved-after-edit.ghx (Grasshopper 1.0.8)
# plug-ins: Pufferfish, AutosaveManager, LunchBox, Weaverbird

autosavemanager = AutosaveUnsavedManager()

# ---- group: Vase
number_slider = Slider(10, range=0..100)
range = Range(Domain=Domain(0, 1), Steps=number_slider)
graph = GraphMapper(range, x0=0, x1=1, y0=0, y1=1, container_name="Bezier", cpx=[0, 0, 1, 1], cpy=[0, 0.7814854383, 0.373115778, 1])
graph_2 = GraphMapper(
    range,
    x0=0,
    x1=1,
    y0=0,
    y1=1,
    container_name="Bezier",
    cpx=[0, 0.9970042109, 0.8781526089, 1],
    cpy=[0, 0.4618318081, 1, 0.3942995071])
multiplication = Multiplication(A=graph_2, B=Slider(5, range=0..100))
pt = ConstructPoint(XCoordinate=graph, YCoordinate=0, ZCoordinate=multiplication)
arrpolar = PolarArray(Geometry=pt, Plane=PlaneXY(0, 0, 0), Count=10, Angle=6.283185307)  # -> Geometry, Transform
item = ListItem(List=arrpolar.Geometry, Index=0, Wrap=True)
x_plus_one = XPlusOne(NumberX=number_slider)
merge = Merge(Data1=arrpolar.Geometry, Data2=item)
srfgrid = SurfaceFromPoints(Points=flatten(merge), UCount=x_plus_one, Interpolate=invert(False))  # -> reparameterize(Surface)

# ----
acceptanceedit = Panel(autosavemanager)
graph_3 = GraphMapper(
    range,
    x0=0,
    x1=1,
    y0=0,
    y1=1,
    container_name="Bezier",
    cpx=[0, 0.9970042109, 0.8781526089, 1],
    cpy=[0, 0.4618318081, 1, 0.3240911365])

# ---- group: Grid
number_slider_2 = Slider(100, range=0..100)
grid = GridStructure(Surface=srfgrid, UDivisions=number_slider_2, VDivisions=Slider(100, range=0..100))  # -> StructureLines, StructureNodes
x_plus_one_2 = XPlusOne(NumberX=number_slider_2)
pt_2 = Point(reverse(grid.StructureNodes))
partition = PartitionList(List=pt_2, Size=x_plus_one_2)  # -> simplify(Chunks)

# ----
number_slider_3 = Slider(0.062, range=0..1)  # disabled
toggle = BooleanToggle(True)  # disabled
toggle_2 = BooleanToggle(False)  # disabled
number_slider_4 = Slider(200, range=0..1000)  # disabled
number_slider_5 = Slider(0, range=0..1)  # disabled
toggle_3 = BooleanToggle(True)  # disabled
toggle_4 = BooleanToggle(False)  # disabled
toggle_5 = BooleanToggle(False)  # disabled
panel = Panel("30000")  # disabled
hull3d = ConvexHull3D()  # -> Hull, Indices; disabled
c_script = CSharpScript()  # -> out, A; inputs mesh: Mesh, timeoutMs: Int32; disabled
# ---------- c_script: C# ----------
// Grasshopper Script Instance
#region Usings
using System;
using System.Linq;
using System.Threading;
using System.Threading.Tasks;
using Rhino;
using Rhino.Geometry;
#endregion

public class Script_Instance : GH_ScriptInstance
{
  private void RunScript(Mesh mesh, int timeoutMs, ref object A)
  {
    if (mesh == null || !mesh.IsValid)
    {
      A = "Invalid mesh";
      return;
    }

    Mesh hull = null;
    Exception error = null;

    var task = Task.Run(() =>
    {
      try
      {
        var h = Mesh.CreateConvexHull3D(
            mesh.Vertices.ToPoint3dArray(),
            out _, 
            RhinoDocument.ModelAbsoluteTolerance, 
            RhinoDocument.PageAngleToleranceRadians);
        if (h != null && h.IsValid)
        {
          h.UnifyNormals();
          h.Normals.ComputeNormals();
          hull = h;
        }
      }
      catch (Exception ex)
      {
        error = ex;
      }
    });

    if (task.Wait(timeoutMs))
    {
      if (error != null)
        A = "Error: " + error.Message;
      else
        A = (object)hull ?? "Convex hull failed";
    }
    else
    {
      A = $"Timeout after {timeoutMs}ms";
    }
  }
}
# ---------- end c_script ----------
c_script_2 = CSharpScript(timeoutMs=panel)  # -> out, A; inputs mesh: Mesh, timeoutMs: Int32; disabled
# ---------- c_script_2: C# ----------
// Grasshopper Script Instance
#region Usings
using System;
using System.Linq;
using System.Threading;
using System.Threading.Tasks;
using System.Collections.Generic;

using Rhino;
using Rhino.Geometry;

using Grasshopper;
using Grasshopper.Kernel;
using Grasshopper.Kernel.Types;
#endregion

public class Script_Instance : GH_ScriptInstance
{
  // State between runs (pattern you already use)
  private bool _shouldExpire = false;
  private string _message = string.Empty;
  private Mesh _lastHull = null;

  /// <summary>
  /// RunScript inputs:
  /// mesh (Mesh) - input mesh to compute convex hull from
  /// timeoutMs (int) - timeout in milliseconds to wait for hull result (e.g. 2000)
  /// Output A: either Mesh (on 2nd run when hull is ready) or status string/message
  /// </summary>
  private void RunScript(Mesh mesh, int timeoutMs, ref object A)
  {
    // 1) If this is the second run after the async finished, return stored data & clear flag
    if (_shouldExpire)
    {
      if (_lastHull != null)
        A = _lastHull;
      else
        A = _message ?? "No result";
      // reset for next time
      _shouldExpire = false;
      _lastHull = null;
      _message = string.Empty;
      return;
    }

    // 2) Validate input
    if (mesh == null || !mesh.IsValid)
    {
      A = "Invalid input mesh";
      return;
    }

    if (timeoutMs <= 0) timeoutMs = 2000; // default 2s

    // 3) Kick off the background task that schedules CreateConvexHull3D on the UI thread
    Component.Message = "scheduling hull";
    _ = ComputeConvexHullWithTimeoutAsync(mesh, timeoutMs);

    // 4) Immediately return informative message for this solution pass
    A = $"Computing convex hull (timeout {timeoutMs} ms). Component will re-run when result is ready.";
  }

  // The asynchronous worker. Runs on a background thread; schedules the hull creation on the UI thread.
  private async Task ComputeConvexHullWithTimeoutAsync(Mesh meshInput, int timeoutMs)
  {
    // set UI feedback
    RhinoApp.InvokeOnUiThread((Action)(() => { Component.Message = "working"; }));

    var tcs = new TaskCompletionSource<Mesh>(TaskCreationOptions.RunContinuationsAsynchronously);

    // Schedule work on UI thread (avoid calling CreateConvexHull3D directly from the GH RunScript main thread
    // because we want to control wait semantics from the background task)
    RhinoApp.InvokeOnUiThread((Action)delegate
    {
      try
      {
        // Use the signature you provided:
        // Mesh.CreateConvexHull3D(Point3d[] pts, out int[] faceIndices, double tolerance, double angleTolerance)
        Mesh hull = Mesh.CreateConvexHull3D(
            meshInput.Vertices.ToPoint3dArray(), 
            out var faceIndices, 
            RhinoDocument.ModelAbsoluteTolerance, 
            RhinoDocument.PageAngleToleranceRadians);

        if (hull != null && hull.IsValid)
        {
          // Optional: unify normals and compute to make output nicer
          hull.UnifyNormals();
          hull.Normals.ComputeNormals();
          hull.FaceNormals.ComputeFaceNormals();
          tcs.TrySetResult(hull);
        }
        else
        {
          tcs.TrySetException(new Exception("Convex hull returned null or invalid mesh."));
        }
      }
      catch (Exception ex)
      {
        tcs.TrySetException(ex);
      }
    });

    // Wait for either hull completion or timeout
    var completed = await Task.WhenAny(tcs.Task, Task.Delay(timeoutMs)).ConfigureAwait(false);

    if (completed == tcs.Task)
    {
      // Success: stash result for next GH run and prepare expiry
      try
      {
        _lastHull = tcs.Task.Result;
        _message = "Convex hull computed successfully.";
      }
      catch (Exception ex)
      {
        _lastHull = null;
        _message = "Convex hull error: " + ex.Message;
      }
    }
    else
    {
      // Timeout
      _lastHull = null;
      _message = $"Convex hull timed out after {timeoutMs} ms.";

      // Optionally you could place a fast fallback hull here (e.g. bounding box or boundary-only hull).
      // Example fallback (uncomment if you want a fallback immediately available):
      //
      // var bb = meshInput.GetBoundingBox(true);
      // _lastHull = Mesh.CreateFromBox(bb, 1, 1, 1);
      // _message += " Fallback: bbox hull generated.";
    }

    // Mark for second run and expire the component on UI thread to trigger the second RunScript
    _shouldExpire = true;
    RhinoApp.InvokeOnUiThread((Action)delegate
    {
      Component.Message = "done";
      Component.ExpireSolution(true); // trigger a second solution so RunScript returns hull or message
    });
  }

  // (Optional helper demonstrating corrected ClosestPoint usage if you want to later compute distances)
  private static double DistanceToMeshClosest(Mesh mesh, Point3d p)
  {
    Point3d cp;
    // Use the overload with maxDistance (we use the mesh diagonal as a safe max)
    double maxDist = mesh.GetBoundingBox(false).Diagonal.Length;
    if (mesh.ClosestPoint(p, out cp, mesh.GetBoundingBox(false).Diagonal.Length) > 0) return p.DistanceTo(cp);

    // fallback to brute-force vertex scan (slow but correct)
    double best = double.MaxValue;
    foreach (Point3d v in mesh.Vertices)
    {
      double d = p.DistanceTo(v);
      if (d < best) best = d;
    }
    return best;
  }
}
# ---------- end c_script_2 ----------
c_script_3 = CSharpScript(iterations=Slider(200, range=0..1000))  # -> out, a; inputs iterations: Int32; disabled
# ---------- c_script_3: C# ----------
using System;
using System.Collections;
using System.Collections.Generic;

using Rhino;
using Rhino.Geometry;

using Grasshopper;
using Grasshopper.Kernel;
using Grasshopper.Kernel.Data;
using Grasshopper.Kernel.Types;
using System.Threading;
using System.Threading.Tasks;
/// <summary>
/// This class will be instantiated on demand by the Script component.
/// </summary>
public class Script_Instance : GH_ScriptInstance
{
  /// <summary>Print a String to the [Out] Parameter of the Script component.</summary>
  /// <param name="text">String to print.</param>
  private void Print(string text) { /* Implementation hidden. */ }
  /// <summary>Print a formatted String to the [Out] Parameter of the Script component.</summary>
  /// <param name="format">String format.</param>
  /// <param name="args">Formatting parameters.</param>
  private void Print(string format, params object[] args) { /* Implementation hidden. */ }
  /// <summary>Print useful information about an object instance to the [Out] Parameter of the Script component. </summary>
  /// <param name="obj">Object instance to parse.</param>
  private void Reflect(object obj) { /* Implementation hidden. */ }
  /// <summary>Print the signatures of all the overloads of a specific method to the [Out] Parameter of the Script component. </summary>
  /// <param name="obj">Object instance to parse.</param>
  private void Reflect(object obj, string method_name) { /* Implementation hidden. */ }

  /// <summary>Gets the current Rhino document.</summary>
  private readonly RhinoDoc RhinoDocument;
  /// <summary>Gets the Grasshopper document that owns this script.</summary>
  private readonly GH_Document GrasshopperDocument;
  /// <summary>Gets the Grasshopper script component that owns this script.</summary>
  private readonly IGH_Component Component;
  /// <summary>
  /// Gets the current iteration count. The first call to RunScript() is associated with Iteration==0.
  /// Any subsequent call within the same solution will increment the Iteration count.
  /// </summary>
  private readonly int Iteration;

  /// <summary>
  /// This procedure contains the user code. Input parameters are provided as regular arguments,
  /// Output parameters as ref arguments. You don't have to assign output parameters,
  /// they will have a default value.
  /// </summary>
  private void RunScript(int iterations, ref object a)
  {
    a = null;
    // 2.2 Prevent an infinite cycle in this comps SolveInstance
    if (_shouldExpire)
    {
      //this is the second time SI was invoked => just output _message and expire
      if (!string.IsNullOrEmpty(_message))
        a = _message;
      //      else
      //        Component.Params.Output[1].SolutionExpired.EndInvoke(ExpireDownStreamObjects());
      //.Recipients[0].
      //.OnSolutionExpired(false);
      _shouldExpire = false;
      return;
    }

    AsyncForLoop(iterations); // 1.2 Implementing Async behavior
    if (_shouldExpire) this.GrasshopperDocument.NewSolution(false);

  }

  // <Custom additional code> 
  private bool _shouldExpire = false; // 1. Prevent the expiration flagging
  private string _message = ""; // 1.2.1 Creating data, available downstream after 2nd run

  //  // 1. Prevent the expiration flagging
  //  /// <summary>Skipping using gated override.</summary>
  //  protected override void ExpireDownStreamObjects()
  //  { if (_shouldExpire) this.GrasshopperDocument.NewSolution(false); }

  //1.2 Implementing Async behavior
  /// <summary>Background task mimicing POST request. </summary>
  /// <param name="it">Number to control calculation intensity.</param>
  private async Task AsyncForLoop(int it)
  {
    this.Component.Message = "working";
    await Task.Run(() =>
      {
      int iterations = 0;
      for (int i = 0; i < it; i++)
      {
        double expensive = Math.Sqrt(Math.Sqrt(Math.Sqrt(Math.Sqrt(i))));
        iterations = i;
      }
      Thread.Sleep(it); // slow down even further (using System.Threading;)

      // 1.2.1 Creating data that will be available downstream after 2nd run
      _message = "Completed " + iterations + " iterations";
      _shouldExpire = true; // 2 Changing internal 🚩 after 1st run

      // 2.1 Forcing the compnent to recompute (start 2nd run)
      RhinoApp.InvokeOnUiThread((Action) delegate { this.Component.ExpireSolution(true); });
      });
    this.Component.Message = "done";
  }


  /// <summary>
  /// This method will be called once every solution, before any calls to RunScript.
  /// </summary>
  public override void BeforeRunScript()
  {

  }
  /// <summary>
  /// This method will be called once every solution, after any calls to RunScript.
  /// </summary>
  public override void AfterRunScript()
  { }

  // </Custom additional code> 
}
# ---------- end c_script_3 ----------
c_script_4 = CSharpScript()  # -> out, OutMesh, InwardFaceIndices, FaceConfidence; inputs M: Mesh, Samples: Int32, Offset: Double, FlipIfInward: Boolean, Verbose: Boolean; disabled
# ---------- c_script_4: C# ----------
// Grasshopper Script Instance
#region Usings
using System;
using System.Linq;
using System.Collections.Generic;

using Rhino;
using Rhino.Geometry;

using Grasshopper;
using Grasshopper.Kernel;
using Grasshopper.Kernel.Types;
#endregion

public class Script_Instance : GH_ScriptInstance
{
    private void RunScript(
		Mesh M,
		int Samples,
		double Offset,
		bool FlipIfInward,
		bool Verbose,
		ref object OutMesh,
		ref object InwardFaceIndices,
		ref object FaceConfidence)
    {
        if (M == null) return;
        if (Samples <= 0) Samples = 200;

        // Work on a cloned mesh
        Mesh mesh = M.DuplicateMesh();
        mesh.Normals.ComputeNormals();
        mesh.FaceNormals.ComputeFaceNormals();

        // Step A: local consistency
        mesh.UnifyNormals();
        mesh.Normals.ComputeNormals();
        mesh.FaceNormals.ComputeFaceNormals();

        int faceCount = mesh.Faces.Count;
        int step = Math.Max(1, faceCount / Samples);
        double bboxDiag = mesh.GetBoundingBox(true).Diagonal.Length;
        double effectiveOffset = Offset > 0 ? Offset : 0.001 * bboxDiag;

        // Step B: convex hull
        Mesh hull = null;
        try
        {
            hull = Mesh.CreateConvexHull3D(mesh.Vertices.ToPoint3dArray(),out _, RhinoDocument.ModelAbsoluteTolerance, RhinoDocument.PageAngleToleranceRadians);
        }
        catch
        {
            if (Verbose) Print("Convex hull failed, falling back to bounding box");
            hull = Mesh.CreateFromBox(mesh.GetBoundingBox(true), 1, 1, 1);
        }
        hull.Normals.ComputeNormals();
        hull.FaceNormals.ComputeFaceNormals();

        // Step C: sample and signed distance
        var inwardIndices = new List<int>();
        double[] confidences = new double[faceCount];
        for (int i = 0; i < faceCount; i++) confidences[i] = double.NaN;

        for (int i = 0; i < faceCount; i += step)
        {
            MeshFace f = mesh.Faces[i];
            Point3d centroid = FaceCentroid(mesh, f);
            Vector3d normal = mesh.FaceNormals[i];
            normal.Unitize();

            Point3d testOut = centroid + normal * effectiveOffset;
            Point3d testIn = centroid - normal * effectiveOffset;

            double outDist = DistanceToMesh(hull, testOut);
            double inDist = DistanceToMesh(hull, testIn);

            bool outInside = hull.IsPointInside(testOut, RhinoDoc.ActiveDoc.ModelAbsoluteTolerance, true);
            bool inInside = hull.IsPointInside(testIn, RhinoDoc.ActiveDoc.ModelAbsoluteTolerance, true);

            double signed = 0.0;
            if (outInside && !inInside) signed = -Math.Max(outDist, inDist);
            else if (!outInside && inInside) signed = Math.Max(outDist, inDist);
            else signed = (inDist - outDist);

            confidences[i] = signed;
            if (signed < 0) inwardIndices.Add(i);
        }

        // Step D: neighbor propagation (simple)
        bool[] faceOrientInward = new bool[faceCount];
        for (int i = 0; i < faceCount; i++) faceOrientInward[i] = false;
        foreach (int idx in inwardIndices) faceOrientInward[idx] = true;

        var finalInward = new List<int>();
        for (int i = 0; i < faceCount; i++)
        {
            bool inward = faceOrientInward[i];
            if (!double.IsNaN(confidences[i])) inward = confidences[i] < 0;
            if (inward) finalInward.Add(i);
        }

        // Step E: global flip
        if (FlipIfInward)
        {
            if (finalInward.Count > faceCount / 2)
            {
                mesh.Flip(true, true, true);
                mesh.Normals.ComputeNormals();
                mesh.FaceNormals.ComputeFaceNormals();
                if (Verbose) Print("Mesh flipped globally (majority inward).");
            }
        }

        // Outputs
        OutMesh = mesh;
        InwardFaceIndices = finalInward;
        FaceConfidence = confidences;
    }

    // --- Helpers ---
    private static Point3d FaceCentroid(Mesh mesh, MeshFace face)
    {
        if (face.IsTriangle)
        {
            Point3d a = mesh.Vertices[face.A];
            Point3d b = mesh.Vertices[face.B];
            Point3d c = mesh.Vertices[face.C];
            return new Point3d((a.X + b.X + c.X) / 3.0, (a.Y + b.Y + c.Y) / 3.0, (a.Z + b.Z + c.Z) / 3.0);
        }
        else
        {
            Point3d a = mesh.Vertices[face.A];
            Point3d b = mesh.Vertices[face.B];
            Point3d c = mesh.Vertices[face.C];
            Point3d d = mesh.Vertices[face.D];
            return new Point3d((a.X + b.X + c.X + d.X) / 4.0, (a.Y + b.Y + c.Y + d.Y) / 4.0, (a.Z + b.Z + c.Z + d.Z) / 4.0);
        }
    }

    private static double DistanceToMesh(Mesh mesh, Point3d p)
    {
        Point3d cp;
        if (mesh.ClosestPoint(p, out cp, mesh.GetBoundingBox(false).Diagonal.Length) > 0)
            return p.DistanceTo(cp);

        // fallback: vertex brute-force
        double best = double.MaxValue;
        foreach (Point3d vtx in mesh.Vertices)
        {
            double d = p.DistanceTo(vtx);
            if (d < best) best = d;
        }
        return best;
    }
}
# ---------- end c_script_4 ----------

# ---- group: Mesh
pt_3 = Point(partition)
bang = ExplodeTree(Data=pt_3)  # -> Branch0, Branch1
shift = ShiftList(List=reverse(pt_3), Shift=1, Wrap=invert(True))  # -> reverse(List)
shift_2 = ShiftList(List=pt_3, Shift=1, Wrap=invert(True))
flip = FlipMatrix(Data=shift_2)
flip_2 = FlipMatrix(Data=shift)
shift_3 = ShiftList(List=reverse(flip), Shift=1, Wrap=invert(True))  # -> reverse(simplify(List))
shift_4 = ShiftList(List=flip, Shift=1, Wrap=invert(True))  # -> simplify(List)
shift_5 = ShiftList(List=flip_2, Shift=1, Wrap=invert(True))  # -> simplify(List)
shift_6 = ShiftList(List=reverse(flip_2), Shift=1, Wrap=invert(True))  # -> reverse(simplify(List))
mergecomb = MergeCombine(
    Data1=simplify(graft(shift_3)),
    Data2=simplify(graft(shift_4)),
    Data3=simplify(graft(shift_5)),
    Data4=simplify(graft(shift_6)))
conmesh = ConstructMesh(Vertices=mergecomb, Faces={A=0, B=1, C=2, D=3})  # -> flatten(Mesh)

# ----
null = NullItem(Item=conmesh)  # -> NullFlags, InvalidFlags, Description
cull = CullPattern(List=conmesh, CullPattern=invert(null.InvalidFlags))
mjoin = MeshJoin(Meshes=cull)

# ---- group: Mesh (continued)
wbjoin = WeaverbirdsJoinMeshesAndWeld(Mesh=mjoin, Weld=invert(False))  # disabled
clean = CombineClean(Meshes=mjoin)

# ----
demesh = DeconstructMesh(Mesh=clean)  # -> Vertices, Faces, Colours, Normals; disabled
lng = ListLength(List=demesh.Faces)  # disabled
remap = RemapNumbers(Value=number_slider_3, Source=Domain(0, 1), Target=lng)  # -> Mapped, Clipped; disabled
subtraction = Subtraction(A=lng, B=remap.Mapped)  # disabled
repeat = RepeatData(Data=toggle_2, Length=remap.Mapped)  # disabled
repeat_2 = RepeatData(Data=toggle, Length=subtraction)  # disabled
merge_2 = Merge(Data1=repeat_2, Data2=repeat)  # disabled
cullf = CullFaces(Mesh=clean, Pattern=merge_2)  # disabled
clean_2 = CombineClean(Meshes=cullf)  # disabled
flipm = FlipMesh(Mesh=clean, VertexNormals=True, FaceNormals=True, FaceOrientation=True)
c_script_5 = CSharpScript(M=clean)  # -> out, OutMesh, FaceConfidence; inputs M: Mesh, OffsetFactor: Double; disabled
# ---------- c_script_5: C# ----------
#region Usings
using System;
using System.Collections.Generic;
using Rhino;
using Rhino.Geometry;
using Grasshopper;
using Grasshopper.Kernel;
#endregion

public class Script_Instance : GH_ScriptInstance
{
  /// <summary>
  /// RunScript inputs:
  /// M (Mesh) - input mesh
  /// OffsetFactor (double) - fraction of bbox diagonal to use as offset (e.g. 0.001). If <=0 uses 0.001
  /// Outputs:
  /// OutMesh (Mesh) - oriented mesh
  /// FaceConfidence (double[]) - per-face signed relative area-change (positive => outward)
  /// </summary>
  private void RunScript(
		Mesh M,
		double OffsetFactor,
		ref object OutMesh,
		ref object FaceConfidence)
  {
    // validate
    if (M == null || !M.IsValid) 
    {
      OutMesh = null;
      FaceConfidence = null;
      return;
    }

    // duplicate to avoid mutating input
    Mesh mesh = M.DuplicateMesh();

    // ensure normals present
    mesh.Normals.ComputeNormals();
    mesh.FaceNormals.ComputeFaceNormals();

    int faceCount = mesh.Faces.Count;
    double[] confidences = new double[faceCount];

    // define offset (robust default)
    double bboxDiag = mesh.GetBoundingBox(true).Diagonal.Length;
    double offset = (OffsetFactor > 0.0) ? OffsetFactor * bboxDiag : 0.001 * bboxDiag;

    for (int i = 0; i < faceCount; i++)
    {
      MeshFace f = mesh.Faces[i];

      // gather vertices for this face
      Point3d[] verts = f.IsTriangle
        ? new Point3d[] { mesh.Vertices[f.A], mesh.Vertices[f.B], mesh.Vertices[f.C] }
        : new Point3d[] { mesh.Vertices[f.A], mesh.Vertices[f.B], mesh.Vertices[f.C], mesh.Vertices[f.D] };

      // face normal (already computed above)
      Vector3d normal = mesh.FaceNormals[i];
      if (normal.IsZero) 
      {
        // fallback: compute from geometry
        normal = ComputeFaceNormal(verts);
        if (normal.IsZero) { confidences[i] = 0.0; continue; }
      }
      normal.Unitize();

      // original area (via cross products)
      double Aorig = FaceArea(verts);

      // build offset vertices
      Point3d[] vertsOffset = new Point3d[verts.Length];
      for (int vi = 0; vi < verts.Length; vi++)
        vertsOffset[vi] = verts[vi] + normal * offset;

      double Aoffset = FaceArea(vertsOffset);

      // relative change (safe-guard against zero area)
      double delta = (Aorig > 0.0) ? (Aoffset - Aorig) / Aorig : 0.0;
      confidences[i] = delta; // >0 outward, <0 inward

      // flip winding if delta < 0 (points inward relative to local span)
      if (delta < 0.0)
      {
        if (f.IsTriangle)
          mesh.Faces.SetFace(i, f.A, f.C, f.B); // swap B/C
        else
          mesh.Faces.SetFace(i, f.A, f.D, f.C, f.B); // reverse quad
      }
    }

    // recompute normals after flipping
    mesh.Normals.ComputeNormals();
    mesh.FaceNormals.ComputeFaceNormals();

    OutMesh = mesh;
    FaceConfidence = confidences;
  }

  // Helper: compute face area from 3 or 4 vertices using cross-products.
  private static double FaceArea(Point3d[] verts)
  {
    if (verts == null) return 0.0;
    if (verts.Length == 3)
    {
      Vector3d a = verts[1] - verts[0];
      Vector3d b = verts[2] - verts[0];
      Vector3d cross = Vector3d.CrossProduct(a, b); // explicit instead of ^
      return 0.5 * cross.Length;
    }
    else if (verts.Length == 4)
    {
      Vector3d a1 = verts[1] - verts[0];
      Vector3d b1 = verts[2] - verts[0];
      Vector3d a2 = verts[2] - verts[0];
      Vector3d b2 = verts[3] - verts[0];
      double area1 = 0.5 * Vector3d.CrossProduct(a1, b1).Length;
      double area2 = 0.5 * Vector3d.CrossProduct(a2, b2).Length;
      return area1 + area2;
    }
    else
    {
      // fallback for n-gons: triangulate fan from 0
      double total = 0.0;
      for (int i = 1; i < verts.Length - 1; i++)
      {
        total += 0.5 * Vector3d.CrossProduct(verts[i] - verts[0], verts[i + 1] - verts[0]).Length;
      }
      return total;
    }
  }

  // compute a robust face normal from vertices (fallback)
  private static Vector3d ComputeFaceNormal(Point3d[] verts)
  {
    if (verts == null || verts.Length < 3) return Vector3d.Zero;
    Vector3d acc = Vector3d.Zero;
    // accumulate triangle cross products
    for (int i = 1; i < verts.Length - 1; i++)
      acc += Vector3d.CrossProduct(verts[i] - verts[0], verts[i + 1] - verts[0]);
    return acc;
  }
}
# ---------- end c_script_5 ----------
c_script_6 = CSharpScript(M=clean)  # -> out, OutMesh, DidReverse, ReversedCount, Message; inputs M: Mesh, ReverseNow: Boolean; disabled
# ---------- c_script_6: C# ----------
#region Usings
using System;
using Rhino;
using Rhino.Geometry;
using Grasshopper;
using Grasshopper.Kernel;
#endregion

public class Script_Instance : GH_ScriptInstance
{
  /// <summary>
  /// Inputs:
  ///   M (Mesh)         - input mesh
  ///   ReverseNow (bool)- when true, reverse winding of all faces (triangles and quads)
  /// Outputs:
  ///   OutMesh (Mesh)   - duplicated mesh with possibly reversed face windings
  ///   DidReverse (bool)- true if any face winding was reversed
  ///   ReversedCount(int) - number of faces reversed
  ///   Message (string) - short status
  /// </summary>
  private void RunScript(
		Mesh M,
		bool ReverseNow,
		ref object OutMesh,
		ref object DidReverse,
		ref object ReversedCount,
		ref object Message)
  {
    // validation
    if (M == null || !M.IsValid)
    {
      OutMesh = null;
      DidReverse = false;
      ReversedCount = 0;
      Message = "Invalid input mesh";
      return;
    }

    // duplicate to avoid mutating caller's mesh
    Mesh mesh = M.DuplicateMesh();

    int flipped = 0;
    if (ReverseNow)
    {
      // iterate all faces and swap vertex order
      for (int i = 0; i < mesh.Faces.Count; i++)
      {
        MeshFace f = mesh.Faces[i]; // a copy of the face indices

        if (f.IsTriangle)
        {
          // triangle: (A, B, C) -> (A, C, B)
          mesh.Faces.SetFace(i, f.A, f.C, f.B);
          flipped++;
        }
        else
        {
          // quad: (A, B, C, D) -> (A, D, C, B)
          mesh.Faces.SetFace(i, f.A, f.D, f.C, f.B);
          flipped++;
        }
      }

      // Recompute normals so Rhino's caches match new winding
      mesh.Normals.Clear();
      mesh.FaceNormals.Clear();
      mesh.Normals.ComputeNormals();
      mesh.FaceNormals.ComputeFaceNormals();
    }

    OutMesh = mesh;
    DidReverse = flipped > 0;
    ReversedCount = flipped;
    Message = ReverseNow ? $"Reversed winding on {flipped} faces." : "No change (ReverseNow = false).";
  }
}
# ---------- end c_script_6 ----------
c_script_7 = CSharpScript(mesh=flipm)  # -> out, Flipped, OutMesh; inputs mesh: Mesh
# ---------- c_script_7: C# ----------
using System;
using System.Linq;
using System.Collections.Generic;
using Rhino;
using Rhino.Geometry;

public class Script_Instance : GH_ScriptInstance
{
    private void RunScript(Mesh mesh, ref object Flipped, ref object OutMesh)
    {
        Component.Description = "Determines if a mesh needs face winding correction and optionally flips all faces.";
        Component.Params.Input.Find(i=>i.NickName.ToLower().Contains("mesh"))
            .Description = "Input mesh to analyze and possibly flip.";
        var overideInput = Component.Params.Input.Find(i=>i.NickName.ToLower().Contains("override"));
        if (overideInput != null) overideInput.Description = "If true, forces flipping regardless of computed tendency.";
        Component.Params.Output.Find(i=>i.NickName.ToLower().Contains("flipped"))
            .Description = "Outputs whether the mesh was flipped based on tendency.";
        Component.Params.Output.Find(i=>i.NickName.ToLower().Contains("outmesh"))
            .Description = "Outputs the resulting mesh after potential face winding correction.";
        Component.Message = "";
        if (mesh == null || !mesh.IsValid) { Flipped = false; OutMesh = mesh; return; }
        mesh.Normals.ComputeNormals();
        double minEdge = double.MaxValue;
        for (int i = 0; i < mesh.TopologyEdges.Count; i++)
        {
            double len = mesh.TopologyEdges.EdgeLine(i).Length;
            if (len > 1e-12 && len < minEdge) minEdge = len;
        }
        double offsetLen = 1.1 * ((minEdge < double.MaxValue) ? minEdge * 0.33 : RhinoDoc.ActiveDoc.ModelAbsoluteTolerance);
        double tendency = 0.0;
        for (int fi = 0; fi < mesh.Faces.Count; fi++)
        {
            MeshFace f = mesh.Faces[fi];
            var ids = new List<int>() { f.A, f.B, f.C };
            if (f.IsQuad) ids.Add(f.D);
            var verts = ids.Select(id => (Point3d)mesh.Vertices[id]).ToList();
            var norms = ids.Select(id => (Vector3d)mesh.Normals[id]).ToList();
            tendency += FaceTendency(verts, norms, offsetLen);
        }
        bool flip = tendency < 0;
        //  || flipOverride;
        if (flip)
        {
            for (int i = 0; i < mesh.Faces.Count; i++)
            {
                MeshFace f = mesh.Faces[i];
                if (f.IsTriangle) mesh.Faces.SetFace(i, f.A, f.C, f.B);
                else mesh.Faces.SetFace(i, f.A, f.D, f.C, f.B);
            }
            mesh.Normals.Clear();
            mesh.FaceNormals.Clear();
            mesh.Normals.ComputeNormals();
            mesh.FaceNormals.ComputeFaceNormals();
            Component.Message = "flipped";
        }
        Flipped = flip;
        OutMesh = mesh;
    }

    /// <summary>Computes a per-face tendency value indicating if the face should be considered inward or outward.</summary>
    /// <param name="verts">Vertices of the face.</param>
    /// <param name="norms">Vertex normals corresponding to each vertex.</param>
    /// <param name="offsetLen">Distance to offset vertices along their normals.</param>
    /// <returns>Signed tendency weighted by the original face area.</returns>
    private double FaceTendency(List<Point3d> verts, List<Vector3d> norms, double offsetLen)
    {
        double sumOrig = CrossSum(verts);
        var vertsOffset = verts.Select((v, i) => v + norms[i] * offsetLen).ToList();
        double sumOffset = CrossSum(vertsOffset);
        return (sumOrig < sumOffset ? sumOrig : -sumOrig);
    }

    /// <summary>Computes the aggregate cross product length (related to spanned area) around the face centroid.</summary>
    /// <param name="verts">Vertices of the face.</param>
    /// <returns>Sum of cross product lengths for the face.</returns>
    private double CrossSum(List<Point3d> verts)
    {
        var centroid = ComputeCentroid(verts);
        double sum = 0.0;
        for (int i = 0; i < verts.Count; i++)
        {
            Vector3d v1 = verts[i] - centroid;
            Vector3d v2 = verts[(i + 1) % verts.Count] - centroid;
            Vector3d cross = Vector3d.CrossProduct(v1, v2);
            sum += cross.Length;
        }
        return Math.Abs(sum);
    }

    /// <summary>Computes the centroid of a set of points.</summary>
    /// <param name="pts">List of points.</param>
    /// <returns>Centroid as a Point3d.</returns>
    private Point3d ComputeCentroid(List<Point3d> pts)
    {
        return new Point3d(
            pts.Average(p => p.X),
            pts.Average(p => p.Y),
            pts.Average(p => p.Z)
        );
    }
}
# ---------- end c_script_7 ----------
c_script_8 = CSharpScript(mesh=flipm)  # -> out, A, B; inputs mesh: Mesh
# ---------- c_script_8: C# ----------
// Grasshopper Script Instance
#region Usings
using System;
using System.Linq;
using Rhino;
using Rhino.Geometry;
#endregion

public class Script_Instance : GH_ScriptInstance
{
  private void RunScript(Mesh mesh, ref object A, ref object B)
  {
    if (mesh == null || !mesh.IsValid)
    {
      A = null;
      B = "Invalid mesh";
      return;
    }

    // Compute centroid of all vertices
    Point3d centroid = Point3d.Unset;
    foreach (var v in mesh.Vertices) centroid += v;
    centroid /= mesh.Vertices.Count;

    // Sum signed volumes of tetrahedrons (centroid + face triangle)
    double volumeSum = 0.0;
    for (int i = 0; i < mesh.Faces.Count; i++)
    {
      var f = mesh.Faces[i];
      Point3d p0 = mesh.Vertices[f.A];
      Point3d p1 = mesh.Vertices[f.B];
      Point3d p2 = mesh.Vertices[f.C];

      if (f.IsQuad)
      {
        Point3d p3 = mesh.Vertices[f.D];
        volumeSum += SignedTetraVolume(centroid, p0, p1, p2);
        volumeSum += SignedTetraVolume(centroid, p0, p2, p3);
      }
      else
      {
        volumeSum += SignedTetraVolume(centroid, p0, p1, p2);
      }
    }

    bool flipped = false;
    if (volumeSum < 0)
    {
      mesh.Flip(true, true, true);
      flipped = true;
    }

    A = mesh;
    B = flipped ? "Mesh flipped" : "Mesh kept";
  }

  // Signed volume of tetrahedron (p0,p1,p2,p3)
  private double SignedTetraVolume(Point3d p0, Point3d p1, Point3d p2, Point3d p3)
  {
    var v1 = new Vector3d(p1 - p0);
    var v2 = new Vector3d(p2 - p0);
    var v3 = new Vector3d(p3 - p0);
    return (v1 * Vector3d.CrossProduct(v2, v3)) / 6.0;
  }
}
# ---------- end c_script_8 ----------
panel_2 = Panel(c_script_7.Flipped)
facen = FaceNormals(Mesh=c_script_7.OutMesh)  # -> Centers, Normals
amp = Amplitude(Vector=facen.Normals, Amplitude=Slider(0.084, range=0..1))
vdis = VectorDisplay(Anchor=facen.Centers, Vector=amp)
